# Grasshopper definition spinforce weaving.gh (Grasshopper 1.0.4)
# plug-ins: Anemone, Nursery

# ----
# srf input
srf = Surface(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)

brep = Brep(srf)

# ----
# creat starting points
brep_edges = BrepEdges(Brep=brep)  # -> Naked, Interior, NonManifold
number_slider = Slider(15, range=0..100)
item = ListItem(List=brep_edges.Naked, Index=0, Wrap=True)  # -> Item2, Item1, Item
item_2 = ListItem(List=brep_edges.Naked, Index=0, Wrap=True)  # -> Item, Item1
divide = DivideCurve(Curve=item.Item1, Count=number_slider, Kinks=False)  # -> Points, Tangents, Parameters
divide_2 = DivideCurve(Curve=item_2.Item1, Count=number_slider, Kinks=False)  # -> Points, Tangents, Parameters

surface = Surface(brep)

button = Button()
number_slider_2 = Slider(110, range=1..172)

# ----
# Placement of spinforces
number_slider_3 = Slider(0.49, range=0..1)

loop_start = LoopStart(Repeat=number_slider_2, Trigger=button, Data=divide_2.Points)  # -> port, Counter, Data
# Direction 1
# Direction 2
loop_start_2 = LoopStart(Repeat=number_slider_2, Trigger=button, Data=divide.Points)  # -> port, Counter, Data

# ----
# position spin force 5
construct_point = ConstructPoint(XCoordinate=Slider(0.5, range=0..1), YCoordinate=Slider(0.5, range=0..1), ZCoordinate=0)
evaluate_surface = EvaluateSurface(Surface=reparameterize(surface), Point=construct_point)  # -> Point, Normal, UDirection, VDirection, Frame

# ----
# position spin force 3
construct_point_2 = ConstructPoint(XCoordinate=Slider(0.18, range=0..1), YCoordinate=Slider(0.58, range=0..1), ZCoordinate=0)
evaluate_surface_2 = EvaluateSurface(Surface=reparameterize(surface), Point=construct_point_2)  # -> Point, Normal, UDirection, VDirection, Frame

# ----
# position spin force 4
construct_point_3 = ConstructPoint(XCoordinate=Slider(0.84, range=0..1), YCoordinate=Slider(0.48, range=0..1), ZCoordinate=0)
evaluate_surface_3 = EvaluateSurface(Surface=reparameterize(surface), Point=construct_point_3)  # -> Point, Normal, UDirection, VDirection, Frame

# ----
# position spin force 2
construct_point_4 = ConstructPoint(XCoordinate=Slider(0.76, range=0..1), YCoordinate=Slider(0.41, range=0..1), ZCoordinate=0)
evaluate_surface_4 = EvaluateSurface(Surface=reparameterize(surface), Point=construct_point_4)  # -> Point, Normal, UDirection, VDirection, Frame

# ----
# position spin force 1
construct_point_5 = ConstructPoint(XCoordinate=number_slider_3, YCoordinate=Slider(0.53, range=0..1), ZCoordinate=0)
evaluate_surface_5 = EvaluateSurface(Surface=reparameterize(surface), Point=construct_point_5)  # -> Point, Normal, UDirection, VDirection, Frame

number_slider_4 = Slider(0.5, range=0..20.0001)

# ----
# bounding box
# for spinforces
bbox = BoundingBox(Content=brep, Plane=PlaneXY(0, 0, 0), UnionBox=True)  # -> Box, Box_2

# ----
# Spin foces
fspin = SpinForce(
    Plane=evaluate_surface_5.Point,
    Strength=Slider(0.75, range=0..20),
    Radius=Slider(5.5, range=0..18),
    Decay=2,
    Bounds=bbox.Box)  # disabled
fspin_2 = SpinForce(
    Plane=evaluate_surface_4.Point,
    Strength=Slider(0.75, range=0..40),
    Radius=Slider(5.6, range=0..8),
    Decay=2,
    Bounds=bbox.Box)
fspin_3 = SpinForce(
    Plane=evaluate_surface_2.Point,
    Strength=Slider(0.75, range=0..40),
    Radius=Slider(5.7, range=0..10),
    Decay=2,
    Bounds=bbox.Box)
fspin_4 = SpinForce(
    Plane=evaluate_surface_3.Point,
    Strength=Slider(1, range=0..10),
    Radius=Slider(3.8, range=0..10),
    Decay=2,
    Bounds=bbox.Box)  # disabled
fspin_5 = SpinForce(Plane=evaluate_surface.Point, Strength=Slider(1, range=0..10), Radius=Slider(1.5, range=0..10), Decay=2, Bounds=bbox.Box)  # disabled
mergef = MergeFields(Fields=[fspin, fspin_2, fspin_3, fspin_4, fspin_5])

data_dam = DataDam(DataDataA=mergef, BufferDelay=10000000, BufferMode=0)

evf = EvaluateField(Field=flatten(data_dam), Point=loop_start_2.Data)  # -> Tensor, Strength
unit_x = UnitX(Factor=number_slider_4)
addition = Addition(A=unit_x, B=evf.Tensor)
move = Move(Geometry=loop_start_2.Data, Motion=addition)  # -> Geometry, Transform
brep_closest_point = BrepClosestPoint(Point=move.Geometry, Brep=brep)  # -> Point, Normal, Distance

evf_2 = EvaluateField(Field=flatten(data_dam), Point=loop_start.Data)  # -> Tensor, Strength
neg = Negative(Value=number_slider_4)
unit_x_2 = UnitX(Factor=neg)
addition_2 = Addition(A=unit_x_2, B=evf_2.Tensor)
move_2 = Move(Geometry=loop_start.Data, Motion=addition_2)  # -> Geometry, Transform
brep_closest_point_2 = BrepClosestPoint(Point=move_2.Geometry, Brep=brep)  # -> Point, Normal, Distance

loop_end = LoopEnd(
    port=loop_start.port,
    Exit=False,
    Data=brep_closest_point_2.Point,
    pausedState=False,
    state="Constant & Record",
    TimeOutVal=0)  # -> simplify(Data)
flip = FlipMatrix(Data=loop_end)
intcrv = Interpolate(Vertices=flip, Degree=3, Periodic=False, KnotStyle=0)  # -> Curve, Length, Domain
curve = Curve(item.Item1)
curve_curve = CurveCurve(CurveA=intcrv.Curve, CurveB=curve)  # -> Points, ParamsA, ParamsB
shatter = Shatter(Curve=intcrv.Curve, Parameters=curve_curve.ParamsA)
list_item = ListItem(List=shatter, Index=0, Wrap=True)  # -> flatten(Item)

loop_end_2 = LoopEnd(
    port=loop_start_2.port,
    Exit=False,
    Data=brep_closest_point.Point,
    pausedState=False,
    state="Constant & Record",
    TimeOutVal=0)  # -> simplify(Data)
flip_2 = FlipMatrix(Data=loop_end_2)
intcrv_2 = Interpolate(Vertices=flip_2, Degree=3, Periodic=False, KnotStyle=0)  # -> Curve, Length, Domain
curve_2 = Curve(item_2.Item1)
curve_curve_2 = CurveCurve(CurveA=intcrv_2.Curve, CurveB=curve_2)  # -> Points, ParamsA, ParamsB
shatter_2 = Shatter(Curve=intcrv_2.Curve, Parameters=curve_curve_2.ParamsA)
list_item_2 = ListItem(List=shatter_2, Index=0, Wrap=True)  # -> flatten(Item)

merge = Merge(Data1=list_item, Data2=list_item_2)
list_length = ListLength(List=list_item)
partition_list = PartitionList(List=merge, Size=list_length)

data_dam_2 = DataDam(DataDataA=partition_list, BufferDelay=10000000, BufferMode=0)

# ----
# split list into the 2 sets of curves
curve_3 = Curve(data_dam_2)
param_viewer = ParamViewer(curve_3)
list_item_3 = ListItem(List=param_viewer, Index=0, Wrap=True)  # -> Item, Item1
deconstruct_path = DeconstructPath(Branch=list_item_3.Item)
deconstruct_path_2 = DeconstructPath(Branch=list_item_3.Item1)
construct_path = ConstructPath(Indices=deconstruct_path)
construct_path_2 = ConstructPath(Indices=deconstruct_path_2)
tree_branch = TreeBranch(Tree=curve_3, Path=construct_path, MaintainPaths=True)  # -> graft(Branch)
tree_branch_2 = TreeBranch(Tree=curve_3, Path=construct_path_2, MaintainPaths=True)

# ----
# get intersections between lsit a and b
curve_curve_3 = CurveCurve(CurveA=tree_branch, CurveB=tree_branch_2)  # -> simplify(Points), simplify(ParamsA), simplify(ParamsB)

trim_tree = TrimTree(Tree=curve_curve_3.ParamsA, Depth=1)
sort_list = SortList(Keys=trim_tree, ValuesValuesA=trim_tree)  # -> Keys, ValuesValuesA
evaluate_curve = EvaluateCurve(Curve=tree_branch, Parameter=sort_list.ValuesValuesA)  # -> Point, Tangent, Angle
dispatch = Dispatch(List=evaluate_curve.Point, DispatchPattern=[True, False])  # -> simplify(ListA), simplify(ListB)

number_slider_5 = Slider(75, range=0..300)
number_slider_6 = Slider(0.02, range=0..1)

divide_curve = DivideCurve(Curve=tree_branch, Count=number_slider_5, Kinks=False)  # -> simplify(flatten(Points)), Tangents, Parameters
closest_point = ClosestPoint(Point=flatten(dispatch.ListA), Cloud=flatten(divide_curve.Points))  # -> ClosestPoint, CPIndex, Distance
closest_point_2 = ClosestPoint(Point=flatten(dispatch.ListB), Cloud=flatten(divide_curve.Points))  # -> ClosestPoint, CPIndex, Distance
unit_z = UnitZ(Factor=number_slider_6)
reverse = Reverse(Vector=unit_z)
move_3 = Move(Geometry=closest_point.ClosestPoint, Motion=unit_z)  # -> Geometry, Transform
move_4 = Move(Geometry=closest_point_2.ClosestPoint, Motion=reverse)  # -> Geometry, Transform
replace_items = ReplaceItems(List=divide_curve.Points, Item=move_3.Geometry, Indices=closest_point.CPIndex, Wrap=False)
replace_items_2 = ReplaceItems(List=replace_items, Item=move_4.Geometry, Indices=closest_point_2.CPIndex, Wrap=False)
partition_list_2 = PartitionList(List=replace_items_2, Size=expr("x+1", number_slider_5))

divide_curve_2 = DivideCurve(Curve=tree_branch_2, Count=number_slider_5, Kinks=False)  # -> simplify(flatten(Points)), Tangents, Parameters
closest_point_3 = ClosestPoint(Point=flatten(dispatch.ListB), Cloud=flatten(divide_curve_2.Points))  # -> ClosestPoint, CPIndex, Distance
closest_point_4 = ClosestPoint(Point=flatten(dispatch.ListA), Cloud=flatten(divide_curve_2.Points))  # -> ClosestPoint, CPIndex, Distance
unit_z_2 = UnitZ(Factor=number_slider_6)
reverse_2 = Reverse(Vector=unit_z_2)
move_5 = Move(Geometry=closest_point_4.ClosestPoint, Motion=reverse_2)  # -> Geometry, Transform
move_6 = Move(Geometry=closest_point_3.ClosestPoint, Motion=unit_z_2)  # -> Geometry, Transform
replace_items_3 = ReplaceItems(List=divide_curve_2.Points, Item=move_6.Geometry, Indices=closest_point_3.CPIndex, Wrap=False)
replace_items_4 = ReplaceItems(List=replace_items_3, Item=move_5.Geometry, Indices=closest_point_4.CPIndex, Wrap=False)
partition_list_3 = PartitionList(List=replace_items_4, Size=expr("x+1", number_slider_5))

deconstruct = Deconstruct(Point=partition_list_3)  # -> XComponent, YComponent, ZComponent
sort_list_2 = SortList(Keys=deconstruct.XComponent, ValuesValuesA=partition_list_3)  # -> Keys, ValuesValuesA
interpolate = Interpolate(Vertices=sort_list_2.ValuesValuesA, Degree=3, Periodic=False, KnotStyle=1)  # -> Curve, Length, Domain

interpolate_2 = Interpolate(Vertices=partition_list_2, Degree=3, Periodic=False, KnotStyle=1)  # -> Curve, Length, Domain
data_dam_3 = DataDam(DataDataA=[interpolate_2.Curve, interpolate.Curve], BufferDelay=10000000, BufferMode=0)
pipe = Pipe(Curve=data_dam_3, Radius=Slider(0.05, range=0..0.1), Caps=0)

data_dam_4 = DataDam(DataA=closest_point.CPIndex, BufferDelay=10000000, BufferMode=0)
data_dam_5 = DataDam(DataDataA=replace_items_2, BufferDelay=10000000, BufferMode=0)
data_dam_6 = DataDam(DataA=closest_point_2.CPIndex, BufferDelay=10000000, BufferMode=0)
data_dam_7 = DataDam(DataDataA=pipe, BufferDelay=10000000, BufferMode=0)
data_dam_8 = DataDam(DataA=closest_point_3.CPIndex, BufferDelay=10000000, BufferMode=0)
data_dam_9 = DataDam(DataA=replace_items_4, BufferDelay=10000000, BufferMode=0)
data_dam_10 = DataDam(DataA=closest_point_4.CPIndex, BufferDelay=10000000, BufferMode=0)

number_slider_7 = Slider(-2, range=-10..0)
number_slider_8 = Slider(200, range=0..200)

shift_list = ShiftList(Shift=number_slider_7, Wrap=False)
divide_curve_3 = DivideCurve(Curve=[shift_list, data_dam_3], Count=number_slider_8, Kinks=False)  # -> Points, Tangents, Parameters
flip_matrix = FlipMatrix(Data=divide_curve_3.Points)
polyline = PolyLine(Vertices=flip_matrix, Closed=False)

# ----
# secundary structure
shift_list_2 = ShiftList(Shift=number_slider_7, Wrap=False)
divide_curve_4 = DivideCurve(Curve=[shift_list_2, data_dam_7], Count=number_slider_8, Kinks=False)  # -> Points, Tangents, Parameters
flip_matrix_2 = FlipMatrix(Data=divide_curve_4.Points)
polyline_2 = PolyLine(Vertices=flip_matrix_2, Closed=False)

number_slider_9 = Slider(300, range=0..300)
number_slider_10 = Slider(0.02, range=0..0.1)

explode = Explode(Curve=polyline, Recursive=True)  # -> Segments, Vertices
dispatch_2 = Dispatch(List=explode.Segments, DispatchPattern=[True, False])  # -> ListA, ListB
curve_4 = Curve(flatten(dispatch_2.ListA))

explode_2 = Explode(Curve=polyline_2, Recursive=True)  # -> Segments, Vertices
dispatch_3 = Dispatch(List=explode_2.Segments, DispatchPattern=[True, False])  # -> ListA, ListB
curve_5 = Curve(flatten(dispatch_3.ListA))
data = Data(flatten(data_dam_7))
collision_one_many = CollisionOneMany(Collider=curve_5, Obstacles=graft(data))  # -> Collision, Index
flip_matrix_3 = FlipMatrix(Data=collision_one_many.Collision)
mass_addition = MassAddition(Input=flip_matrix_3)  # -> flatten(Result), PartialResults
larger_than = LargerThan(FirstNumber=mass_addition.Result, SecondNumber="2")  # -> LargerThan, OrEqualTo
dispatch_4 = Dispatch(List=curve_5, DispatchPattern=larger_than.LargerThan)  # -> ListA, ListB
curve_6 = Curve(dispatch_4.ListB)
number_slider_11 = Slider(0.01, range=0..0.1)

list_item_4 = ListItem(List=data_dam_9, Index=data_dam_8, Wrap=True)
list_item_5 = ListItem(List=data_dam_9, Index=expr("x+1", data_dam_8), Wrap=True)
line = Line(StartPoint=list_item_4, EndPoint=list_item_5)
plane_normal = PlaneNormal(Origin=list_item_4, ZAxis=line)

list_item_6 = ListItem(List=data_dam_5, Index=data_dam_4, Wrap=True)
list_item_7 = ListItem(List=data_dam_5, Index=expr("x+1", data_dam_4), Wrap=True)
line_2 = Line(StartPoint=list_item_6, EndPoint=list_item_7)
plane_normal_2 = PlaneNormal(Origin=list_item_6, ZAxis=line_2)

list_item_8 = ListItem(List=data_dam_5, Index=data_dam_6, Wrap=True)
list_item_9 = ListItem(List=data_dam_5, Index=expr("x+1", data_dam_6), Wrap=True)
line_3 = Line(StartPoint=list_item_8, EndPoint=list_item_9)
plane_normal_3 = PlaneNormal(Origin=list_item_8, ZAxis=line_3)

list_item_10 = ListItem(List=data_dam_9, Index=data_dam_10, Wrap=True)
list_item_11 = ListItem(List=data_dam_9, Index=expr("x+1", data_dam_10), Wrap=True)
line_4 = Line(StartPoint=list_item_10, EndPoint=list_item_11)
plane_normal_4 = PlaneNormal(Origin=list_item_10, ZAxis=line_4)

# ----
# connections
number_slider_12 = Slider(0.06, range=0..1)
number_slider_13 = Slider(30, range=0..100)

circle = Circle(Plane=plane_normal_2, Radius=number_slider_12)

circle_2 = Circle(Plane=plane_normal, Radius=number_slider_12)

circle_3 = Circle(Plane=plane_normal_3, Radius=number_slider_12)

circle_4 = Circle(Plane=plane_normal_4, Radius=number_slider_12)

data_dam_11 = DataDam(DataDataA=[circle, circle_3, circle_2, circle_4], BufferDelay=10000000, BufferMode=0)

divide_curve_5 = DivideCurve(Curve=circle_2, Count=number_slider_13, Kinks=False)  # -> Points, Tangents, Parameters
divide_curve_6 = DivideCurve(Curve=circle_3, Count=number_slider_13, Kinks=False)  # -> Points, Tangents, Parameters
curve_closest_point = CurveClosestPoint(Point=divide_curve_5.Points, Curve=graft(circle_3))  # -> Point, Parameter, Distance
curve_closest_point_2 = CurveClosestPoint(Point=divide_curve_6.Points, Curve=graft(circle_2))  # -> Point, Parameter, Distance
list_item_12 = ListItem(List=curve_closest_point_2.Point, Index=0, Wrap=True)
list_item_13 = ListItem(List=curve_closest_point.Point, Index=0, Wrap=True)
line_5 = Line(StartPoint=list_item_12, EndPoint=list_item_13)

divide_curve_7 = DivideCurve(Curve=circle_4, Count=number_slider_13, Kinks=False)  # -> Points, Tangents, Parameters
divide_curve_8 = DivideCurve(Curve=circle, Count=number_slider_13, Kinks=False)  # -> Points, Tangents, Parameters
curve_closest_point_3 = CurveClosestPoint(Point=divide_curve_7.Points, Curve=graft(circle))  # -> Point, Parameter, Distance
curve_closest_point_4 = CurveClosestPoint(Point=divide_curve_8.Points, Curve=graft(circle_4))  # -> Point, Parameter, Distance
list_item_14 = ListItem(List=curve_closest_point_4.Point, Index=0, Wrap=True)
list_item_15 = ListItem(List=curve_closest_point_3.Point, Index=0, Wrap=True)
line_6 = Line(StartPoint=list_item_14, EndPoint=list_item_15)

mesh_pipe = MeshPipe(Curve=data_dam_11, NumberOfSections=number_slider_9, Radius=number_slider_10, NumberOfSides=4)
mesh_pipe_2 = MeshPipe(Curve=[line_6, line_5], NumberOfSections=number_slider_9, Radius=number_slider_10, NumberOfSides=4)

collision_one_many_2 = CollisionOneMany(Collider=curve_4, Obstacles=graft(data))  # -> Collision, Index
flip_matrix_4 = FlipMatrix(Data=collision_one_many_2.Collision)
mass_addition_2 = MassAddition(Input=flip_matrix_4)  # -> flatten(Result), PartialResults
larger_than_2 = LargerThan(FirstNumber=mass_addition_2.Result, SecondNumber="2")  # -> LargerThan, OrEqualTo
dispatch_5 = Dispatch(List=curve_4, DispatchPattern=larger_than_2.LargerThan)  # -> ListA, ListB
curve_7 = Curve(dispatch_5.ListB)
data_2 = Data(flatten([mesh_pipe, mesh_pipe_2]))
collision_one_many_3 = CollisionOneMany(Collider=flatten(curve_7), Obstacles=graft(data_2))  # -> Collision, Index
flip_matrix_5 = FlipMatrix(Data=collision_one_many_3.Collision)
mass_addition_3 = MassAddition(Input=flip_matrix_5)  # -> flatten(Result), PartialResults
larger_than_3 = LargerThan(FirstNumber=mass_addition_3.Result, SecondNumber="0")  # -> LargerThan, OrEqualTo
dispatch_6 = Dispatch(List=curve_7, DispatchPattern=larger_than_3.LargerThan)  # -> ListA, ListB
curve_8 = Curve(dispatch_6.ListB)
pipe_2 = Pipe(Curve=curve_8, Radius=number_slider_11, Caps=0)

data_3 = Data(flatten([mesh_pipe, mesh_pipe_2]))
collision_one_many_4 = CollisionOneMany(Collider=flatten(curve_6), Obstacles=graft(data_3))  # -> Collision, Index
flip_matrix_6 = FlipMatrix(Data=collision_one_many_4.Collision)
mass_addition_4 = MassAddition(Input=flip_matrix_6)  # -> flatten(Result), PartialResults
larger_than_4 = LargerThan(FirstNumber=mass_addition_4.Result, SecondNumber="0")  # -> LargerThan, OrEqualTo
dispatch_7 = Dispatch(List=curve_6, DispatchPattern=larger_than_4.LargerThan)  # -> ListA, ListB
curve_9 = Curve(dispatch_7.ListB)
pipe_3 = Pipe(Curve=curve_9, Radius=number_slider_11, Caps=0)
