# Grasshopper definition surface generation.gh (Grasshopper 1.0.4)

negative = Negative(Value=Slider(0.1, range=0..1))
unit_z = UnitZ(Factor=negative)
rectangle = Rectangle(Plane=PlaneXY(0, 0, 0), XSize=Slider(10, range=0..10), YSize=Slider(6, range=0..10), Radius=0)  # -> Rectangle, Length
offset_curve = OffsetCurve(Curve=rectangle.Rectangle, Distance=Slider(2, range=0..10), Plane=PlaneXY(0, 0, 0), Corners=1)
surface = Surface(offset_curve)
extrude = Extrude(Base=surface, Direction=unit_z)
curve = Curve(<curve referenced from the Rhino model>)
curve_2 = Curve(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)
curve_3 = Curve(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)
explode = Explode(Curve=rectangle.Rectangle, Recursive=True)  # -> Segments, Vertices
list_item = ListItem(List=explode.Segments, Index=0, Wrap=True)  # -> Item, Item1, Item2, Item3
curve_4 = Curve(list_item.Item)
curve_5 = Curve(list_item.Item1)
curve_6 = Curve(list_item.Item2)
curve_7 = Curve(list_item.Item3)
evaluate_curve = EvaluateCurve(Curve=reparameterize(curve_4), Parameter=Slider(0.5, range=0..1))  # -> Point, Tangent, Angle
evaluate_curve_2 = EvaluateCurve(Curve=reparameterize(curve_5), Parameter=Slider(0.5, range=0..1))  # -> Point, Tangent, Angle
evaluate_curve_3 = EvaluateCurve(Curve=reparameterize(curve_6), Parameter=Slider(0.5, range=0..1))  # -> Point, Tangent, Angle
evaluate_curve_4 = EvaluateCurve(Curve=reparameterize(curve_7), Parameter=Slider(0.5, range=0..1))  # -> Point, Tangent, Angle
divide_curve = DivideCurve(Curve=curve_4, Count=10, Kinks=False)  # -> Points, Tangents, Parameters
divide_curve_2 = DivideCurve(Curve=curve_5, Count=10, Kinks=False)  # -> Points, Tangents, Parameters
divide_curve_3 = DivideCurve(Curve=curve_6, Count=10, Kinks=False)  # -> Points, Tangents, Parameters
divide_curve_4 = DivideCurve(Curve=curve_7, Count=10, Kinks=False)  # -> Points, Tangents, Parameters
curve_curve = CurveCurve(CurveA=list_item.Item3, CurveB=curve)  # -> Points, ParamsA, ParamsB
distance = Distance(PointA=evaluate_curve.Point, PointB=divide_curve.Points)
distance_2 = Distance(PointA=evaluate_curve_2.Point, PointB=divide_curve_2.Points)
distance_3 = Distance(PointA=evaluate_curve_3.Point, PointB=divide_curve_3.Points)
distance_4 = Distance(PointA=evaluate_curve_4.Point, PointB=divide_curve_4.Points)
bounds = Bounds(Numbers=distance)
bounds_2 = Bounds(Numbers=distance_2)
bounds_3 = Bounds(Numbers=distance_3)
bounds_4 = Bounds(Numbers=distance_4)
deconstruct_domain = DeconstructDomain(Domain=bounds)  # -> Start, End
deconstruct_domain_2 = DeconstructDomain(Domain=bounds_2)  # -> Start, End
deconstruct_domain_3 = DeconstructDomain(Domain=bounds_3)  # -> Start, End
deconstruct_domain_4 = DeconstructDomain(Domain=bounds_4)  # -> Start, End
subtraction = Subtraction(A=distance, B=deconstruct_domain.End)
subtraction_2 = Subtraction(A=distance_2, B=deconstruct_domain_2.End)
subtraction_3 = Subtraction(A=distance_3, B=deconstruct_domain_3.End)
subtraction_4 = Subtraction(A=distance_4, B=deconstruct_domain_4.End)
absolute = Absolute(Value=subtraction)  # -> flatten(Result)
absolute_2 = Absolute(Value=subtraction_2)  # -> flatten(Result)
absolute_3 = Absolute(Value=subtraction_3)  # -> flatten(Result)
absolute_4 = Absolute(Value=subtraction_4)  # -> flatten(Result)
remap_numbers = RemapNumbers(Value=absolute, Source=bounds, Target=Domain(0, 1))  # -> Mapped, Clipped
remap_numbers_2 = RemapNumbers(Value=absolute_2, Source=bounds_2, Target=Domain(0, 1))  # -> Mapped, Clipped
remap_numbers_3 = RemapNumbers(Value=absolute_3, Source=bounds_3, Target=Domain(0, 1))  # -> Mapped, Clipped
remap_numbers_4 = RemapNumbers(Value=absolute_4, Source=bounds_4, Target=Domain(0, 1))  # -> Mapped, Clipped
graph_mapper = GraphMapper(
    remap_numbers_2.Mapped,
    x0=0,
    x1=1,
    y0=0,
    y1=1,
    container_name="Bezier",
    cpx=[0, 0.6064577103, 0.3955361247, 1],
    cpy=[0, 0, 0.9982554317, 1])
graph_mapper_2 = GraphMapper(
    remap_numbers_4.Mapped,
    x0=0,
    x1=1,
    y0=0,
    y1=1,
    container_name="Bezier",
    cpx=[0, 0.6064577103, 0.3955361247, 1],
    cpy=[0, 0, 0.9982554317, 1])
graph_mapper_3 = GraphMapper(
    remap_numbers.Mapped,
    x0=0,
    x1=1,
    y0=0,
    y1=1,
    container_name="Bezier",
    cpx=[0, 0.6064577103, 0.3955361247, 1],
    cpy=[0, 0, 0.9982554317, 1])
graph_mapper_4 = GraphMapper(
    remap_numbers_3.Mapped,
    x0=0,
    x1=1,
    y0=0,
    y1=1,
    container_name="Bezier",
    cpx=[0, 0.6064577103, 0.3955361247, 1],
    cpy=[0, 0, 0.9982554317, 1])
unit_z_2 = UnitZ(Factor=graph_mapper_3)
unit_z_3 = UnitZ(Factor=graph_mapper)
unit_z_4 = UnitZ(Factor=graph_mapper_4)
unit_z_5 = UnitZ(Factor=graph_mapper_2)
move = Move(Geometry=divide_curve.Points, Motion=unit_z_2)  # -> Geometry, Transform
move_2 = Move(Geometry=divide_curve_2.Points, Motion=unit_z_3)  # -> Geometry, Transform
move_3 = Move(Geometry=divide_curve_3.Points, Motion=unit_z_4)  # -> Geometry, Transform
move_4 = Move(Geometry=divide_curve_4.Points, Motion=unit_z_5)  # -> Geometry, Transform
interpolate = Interpolate(Vertices=move_2.Geometry, Degree=3, Periodic=False, KnotStyle=1)  # -> Curve, Length, Domain
interpolate_2 = Interpolate(Vertices=move_4.Geometry, Degree=3, Periodic=False, KnotStyle=1)  # -> Curve, Length, Domain
interpolate_3 = Interpolate(Vertices=move.Geometry, Degree=3, Periodic=False, KnotStyle=1)  # -> Curve, Length, Domain
interpolate_4 = Interpolate(Vertices=move_3.Geometry, Degree=3, Periodic=False, KnotStyle=1)  # -> Curve, Length, Domain
evaluate_curve_5 = EvaluateCurve(Curve=reparameterize(interpolate.Curve), Parameter=Slider(0.5, range=0..1))  # -> Point, Tangent, Angle
evaluate_curve_6 = EvaluateCurve(Curve=reparameterize(interpolate_2.Curve), Parameter=Slider(0.5, range=0..1))  # -> Point, Tangent, Angle
evaluate_curve_7 = EvaluateCurve(Curve=reparameterize(interpolate_3.Curve), Parameter=Slider(0.5, range=0..1))  # -> Point, Tangent, Angle
evaluate_curve_8 = EvaluateCurve(Curve=reparameterize(interpolate_4.Curve), Parameter=Slider(0.5, range=0..1))  # -> Point, Tangent, Angle
line = Line(StartPoint=evaluate_curve_7.Point, EndPoint=evaluate_curve_8.Point)
line_2 = Line(StartPoint=evaluate_curve_5.Point, EndPoint=evaluate_curve_6.Point)
curve_8 = Curve(line)
curve_9 = Curve(line_2)
evaluate_curve_9 = EvaluateCurve(Curve=reparameterize(curve_8), Parameter=Slider(0.5, range=0..1))  # -> Point, Tangent, Angle
evaluate_curve_10 = EvaluateCurve(Curve=reparameterize(curve_9), Parameter=Slider(0.5, range=0..1))  # -> Point, Tangent, Angle
divide_curve_5 = DivideCurve(Curve=curve_8, Count=10, Kinks=False)  # -> Points, Tangents, Parameters
divide_curve_6 = DivideCurve(Curve=curve_9, Count=10, Kinks=False)  # -> Points, Tangents, Parameters
distance_5 = Distance(PointA=evaluate_curve_9.Point, PointB=divide_curve_5.Points)
distance_6 = Distance(PointA=evaluate_curve_10.Point, PointB=divide_curve_6.Points)
bounds_5 = Bounds(Numbers=distance_5)
bounds_6 = Bounds(Numbers=distance_6)
deconstruct_domain_5 = DeconstructDomain(Domain=bounds_5)  # -> Start, End
deconstruct_domain_6 = DeconstructDomain(Domain=bounds_6)  # -> Start, End
subtraction_5 = Subtraction(A=distance_5, B=deconstruct_domain_5.End)
subtraction_6 = Subtraction(A=distance_6, B=deconstruct_domain_6.End)
absolute_5 = Absolute(Value=subtraction_5)  # -> flatten(Result)
absolute_6 = Absolute(Value=subtraction_6)  # -> flatten(Result)
remap_numbers_5 = RemapNumbers(Value=absolute_5, Source=bounds_5, Target=Domain(0, 1))  # -> Mapped, Clipped
remap_numbers_6 = RemapNumbers(Value=absolute_6, Source=bounds_6, Target=Domain(0, 1))  # -> Mapped, Clipped
graph_mapper_5 = GraphMapper(
    remap_numbers_5.Mapped,
    x0=0,
    x1=1,
    y0=0,
    y1=1,
    container_name="Bezier",
    cpx=[0, 0.3478260934, 0.2956542969, 1],
    cpy=[0, 0, 0, 0])
graph_mapper_6 = GraphMapper(
    remap_numbers_6.Mapped,
    x0=0,
    x1=1,
    y0=0,
    y1=1,
    container_name="Bezier",
    cpx=[0, 0.4362333119, 0.3840579689, 1],
    cpy=[0, 0, 0, 0])
unit_z_6 = UnitZ(Factor=graph_mapper_5)
unit_z_7 = UnitZ(Factor=graph_mapper_6)
move_5 = Move(Geometry=divide_curve_5.Points, Motion=unit_z_6)  # -> Geometry, Transform
move_6 = Move(Geometry=divide_curve_6.Points, Motion=unit_z_7)  # -> Geometry, Transform
interpolate_5 = Interpolate(Vertices=move_5.Geometry, Degree=3, Periodic=False, KnotStyle=1)  # -> Curve, Length, Domain
interpolate_6 = Interpolate(Vertices=move_6.Geometry, Degree=3, Periodic=False, KnotStyle=1)  # -> Curve, Length, Domain
curve_10 = Curve(interpolate_4.Curve)
curve_11 = Curve(interpolate_2.Curve)
curve_12 = Curve(interpolate_3.Curve)
curve_13 = Curve(interpolate.Curve)
merge = Merge(Data1=flatten(curve_13), Data2=flatten(interpolate_5.Curve), Data3=flatten(curve_11))
merge_2 = Merge(Data1=flatten(curve_12), Data2=flatten(interpolate_6.Curve), Data3=flatten(curve_10))
panel = Panel(merge)
panel_2 = Panel(merge_2)
network_surface = NetworkSurface(CurvesU=merge, CurvesV=merge_2, Continuity=Slider(3, range=0..3))
unit_z_8 = UnitZ(Factor=Slider(0.04, range=0..0.11))
extrude_2 = Extrude(Base=network_surface, Direction=unit_z_8)
